# Grasshopper definition DisassemblyModel.gh (Grasshopper 1.0.8)
# plug-ins: Robots

# ---- group: Robot setting (only change if necessary) / Set homeposition
home_position = ConstructPoint(XCoordinate=180, YCoordinate=-520, ZCoordinate=600)

# ---- group: Disassembly process / Define end positions
end_position_bricks = Brep([<brep referenced from the Rhino model> x6])
debrep = DeconstructBrep(Brep=end_position_bricks)  # -> Faces, Edges, Vertices
md_slider = MDSlider(SliderMode=0, slider_value=Point(0.5, 0.5, 0.5), x_domain=Domain(0, 1), y_domain=Domain(0, 1), z_domain=Domain(0, 1))
item = ListItem(List=debrep.Faces, Index=5, Wrap=True)
evalsrf = EvaluateSurface(Surface=reparameterize(item), Point=md_slider)  # -> Point, Normal, UDirection, VDirection, Frame
pflip = FlipPlane(Plane=evalsrf.Frame, ReverseX=False, ReverseY=False, SwapAxes=True)

# ---- group: Do NOT change / AruCo definition
aruco_ids = Panel("""3
2
1
0""")
neutral_id = Panel("0")
panel = Panel("""200
200
-207
-207""")
panel_2 = Panel("""-500
-900
-900
-500""")
aruco_positions = ConstructPoint(XCoordinate=panel, YCoordinate=panel_2, ZCoordinate="0")

# ----
number_slider = Slider(3, range=0..4)  # disabled
button = Button()  # disabled
toggle = BooleanToggle(False)  # disabled
toggle_2 = BooleanToggle(False)  # disabled
path = FilePath("C:\Users\suzan\OneDrive\Bouwkunde\Bouwkunde master\Master jaar 2\01_ARIT507\02_CAD\08_CV\poses.json")  # disabled
panel_3 = Panel("0")  # disabled
py3 = Python3Script(
    path=path,
    ref_ids=aruco_ids,
    ref_world=aruco_positions,
    neutral_id=panel_3,
    reset=toggle,
    run=toggle_2,
    next_block=button,
    end_planes=flatten(pflip),
    max_blocks=number_slider)  # -> planes, plane, info, boxes, frozen, flatten(sequence), place_planes, picks; inputs ref_ids: list, ref_world: list of Point3d, next_block: Boolean, end_planes: list; disabled
# ---------- py3: Python ----------
"""
Brick pick + place planes from table camera (GhPython: IronPython 2.7 & Python 3 safe)
=====================================================================================
Reads poses.json (written by camera_toolkit.py) and converts ArUco markers into UR5 pick planes.
"""
import json
import math
import time

import Rhino.Geometry as rg
import scriptcontext as sc
from Grasshopper.Kernel import GH_Document

# ---------------------------------------------------------------- CONFIGURATION & TIMINGS
REF_HOLD = 8.0        # s reference marker stays valid after leaving view
BLOCK_HOLD = 0.5      # s block stays in list after leaving view
MIN_FRAMES = 3        # frames required before block counts
SCAN_TIME = 4.0       # s live scanning before freeze
STABLE_TIME = 0.6     # s batch must remain unchanged
SCAN_MAX = 3.0        # s max scan extension
CLUSTER_GAP = 12.0    # mm height clustering step
BATCH_SAME_LEVEL = True   # False = process 1 block per scan cycle (highest first)
PICK_FLIP = True           # flip pick planes (Z points down into block)
PICK_ROT_DEG = 90.0        # rotation about Z axis
APPROACH_HEIGHT = 50.0    # mm clearance height above pick and place planes

# ---------------------------------------------------------------- HEIGHT & DEDUPLICATION

LEVELS = (50.0, 100.0, 150.0)   # nominal tag top height above the table for layer 1, 2, 3 (mm)
MIN_H = 0.0          # Ignore noise lower than 10mm
MAX_H = 175.0         # Upper filter limit, must stay above the top level plus noise
LAYER_THRESHOLDS = (60.0, 105.0)   # measured height < 60 = layer 1, 60..110 = layer 2, > 110 = layer 3
TILT_MAX = 60.0       # Ignore tags tilted > 45 deg from vertical
DEDUP_DIST = 0.0     # mm duplicate distance (keeps HIGHEST tag in this XY radius)
SHOW_WAITING = False  # False: preview ONLY active target batch

# ---------------------------------------------------------------- Helper Math Functions
def sub(a, b): 
    return (a[0] - b[0], a[1] - b[1], a[2] - b[2])

def mul(a, s): 
    return (a[0] * s, a[1] * s, a[2] * s)

def dot(a, b): 
    return a[0] * b[0] + a[1] * b[1] + a[2] * b[2]

def cross(a, b): 
    return (a[1] * b[2] - a[2] * b[1], a[2] * b[0] - a[0] * b[2], a[0] * b[1] - a[1] * b[0])

def unit(a):
    n = math.sqrt(dot(a, a))
    return (a[0] / n, a[1] / n, a[2] / n) if n > 1e-9 else None

def median(xs):
    xs = sorted(xs)
    n = len(xs)
    m = n // 2
    return xs[m] if n % 2 else 0.5 * (xs[m - 1] + xs[m])

def med3(vs):
    return tuple(median([v[i] for v in vs]) for i in range(3))

def as_list(v):
    if v is None:
        return []
    if isinstance(v, (list, tuple)):
        return list(v)
    try:
        return [x for x in v]
    except TypeError:
        return [v]

def parse_int_list(val):
    raw = as_list(val)
    res = []
    for x in raw:
        try:
            res.append(int(x))
        except (ValueError, TypeError):
            pass
    return res

def inp(name):
    return globals().get(name)

def to_plane(e):
    """Safely converts Planes, Points, GH wrappers, or None preserving exact orientation."""
    if e is None:
        return None
    # 1. Direct Rhino Plane
    if isinstance(e, rg.Plane):
        return rg.Plane(e)
    # 2. GH_Plane or GH wrapper around Plane/Point
    if hasattr(e, "Value"):
        return to_plane(e.Value)
    # 3. Custom Plane object with Origin, XAxis, YAxis
    if hasattr(e, "Origin") and hasattr(e, "XAxis") and hasattr(e, "YAxis"):
        return rg.Plane(e.Origin, e.XAxis, e.YAxis)
    # 4. Point3d / Point3f -> Default WorldXY plane at Point
    if isinstance(e, (rg.Point3d, rg.Point3f)):
        return rg.Plane(rg.Point3d(e.X, e.Y, e.Z), rg.Vector3d(1, 0, 0), rg.Vector3d(0, 1, 0))
    if hasattr(e, "X") and hasattr(e, "Y") and hasattr(e, "Z"):
        return rg.Plane(rg.Point3d(float(e.X), float(e.Y), float(e.Z)), rg.Vector3d(1, 0, 0), rg.Vector3d(0, 1, 0))
    return None

def fit_rotation(pairs):
    sa = sum(lx * wy - ly * wx for lx, ly, wx, wy in pairs)
    sb = sum(lx * wx + ly * wy for lx, ly, wx, wy in pairs)
    th = math.atan2(sa, sb)
    c, s = math.cos(th), math.sin(th)
    err = [math.hypot(c * lx - s * ly - wx, s * lx + c * ly - wy) for lx, ly, wx, wy in pairs]
    return th, math.sqrt(sum(e * e for e in err) / max(1, len(err)))

def offset_above(plane, dist=300.0):
    """Translates plane vertically upward by dist in World Z."""
    p = rg.Plane(plane)
    p.Translate(rg.Vector3d(0.0, 0.0, dist))
    return p

# ---------------------------------------------------------------- Settings & State
nav = 10
toff = (0.0, 0.0)
yaw_extra = 0.0

dims = (100.0, 50.0, 50.0)
try:
    _d = [float(v) for v in as_list(inp("block_dims"))]
    if len(_d) == 3:
        dims = tuple(_d)
except Exception:
    pass

ival = 200

key = "brickplanes_" + str(ghenv.Component.InstanceGuid)
st = sc.sticky.get(key)
if st is None or bool(inp("reset")):
    st = {"last_t": 0.0, "hist": {}, "side": {}, "result": None, "placed": 0,
          "seq": {"state": "SCAN", "prev": False, "t0": time.time(), "sig": None, "sig_t": time.time()}}
    sc.sticky[key] = st
st.setdefault("placed", 0)

def compute():
    info = []
    res = {"info": "", "plane": None, "planes": [], "buried_ids": [], "picks": [], "order_ids": [],
           "later_ids": [], "heights": [], "levels": [], "boxes": [], "labels": [], "frame": None,
           "ref_pts": [], "place_planes": [], "sequence": [], "n_batch": 0, "end_used": st["placed"]}

    ids_ref = parse_int_list(inp("ref_ids"))
    wpts = as_list(inp("ref_world"))
    p_path = inp("path")

    if not p_path:
        res["info"] = "Set 'path' to poses.json"
        return res
    if len(ids_ref) < 3 or len(wpts) != len(ids_ref) or inp("neutral_id") is None or int(inp("neutral_id")) not in ids_ref:
        res["info"] = "Need ref_ids (3+), ref_world (same count/order) and neutral_id in ref_ids"
        return res

    nid = int(inp("neutral_id"))
    world = {i: (p.X, p.Y, p.Z) for i, p in zip(ids_ref, wpts)}

    data = None
    try:
        with open(p_path, "r") as f:
            content = f.read().strip()
            if content:
                data = json.loads(content)
    except Exception:
        pass

    if data is None and not st["hist"]:
        res["info"] = "Cannot read poses.json (is camera toolkit running?)"
        return res

    if data is not None and data.get("t", 0.0) > st["last_t"]:
        st["last_t"] = data["t"]
        for sid, m in data.get("markers", {}).items():
            mid = int(sid)
            R = m["R"]
            ax = (R[0][0], R[1][0], R[2][0])
            nm = (R[0][2], R[1][2], R[2][2])
            h = st["hist"].setdefault(mid, {"t": [], "ax": [], "nm": [], "seen": 0.0})
            h["t"] = (h["t"] + [tuple(m["t"])])[-nav:]
            h["ax"] = (h["ax"] + [ax])[-nav:]
            h["nm"] = (h.get("nm", []) + [nm])[-nav:]
            h["seen"] = data["t"]
        for sid in data.get("side_ids", []):
            st["side"][int(sid)] = data["t"]

    now = st["last_t"]
    for sid in [m for m, ts in st["side"].items() if now - ts > BLOCK_HOLD]:
        del st["side"][sid]
    for mid in [m for m, h in st["hist"].items()
                if now - h["seen"] > (REF_HOLD if m in ids_ref else BLOCK_HOLD)]:
        del st["hist"][mid]

    if time.time() - now > 2.0:
        info.append("WARNING: poses.json stale - check toolkit")

    refs = {i: med3(st["hist"][i]["t"]) for i in ids_ref if i in st["hist"]}
    if nid not in refs or len(refs) < 3:
        res["info"] = ("Need neutral and 3+ reference markers in view. Seen: %s" % (sorted(refs) or "none"))
        return res

    ok, plane = rg.Plane.FitPlaneToPoints([rg.Point3d(*p) for p in refs.values()])
    if ok != rg.PlaneFitResult.Success:
        res["info"] = "Plane fit failed - references must not be collinear"
        return res

    c = (plane.Origin.X, plane.Origin.Y, plane.Origin.Z)
    n = (plane.ZAxis.X, plane.ZAxis.Y, plane.ZAxis.Z)
    if n[2] > 0:
        n = mul(n, -1.0)
    p0 = refs[nid]
    O = sub(p0, mul(n, dot(sub(p0, c), n)))

    other = sorted(i for i in refs if i != nid)[0]
    v = sub(refs[other], O)
    ex = unit(sub(v, mul(n, dot(v, n))))
    ey = cross(n, ex)

    def local(p):
        r = sub(p, O)
        return dot(r, ex), dot(r, ey), dot(r, n)

    w0 = world[nid]
    lpairs = []
    for i, p in refs.items():
        if i == nid:
            continue
        lx, ly, _lz = local(p)
        lpairs.append((lx, ly, world[i][0] - w0[0], world[i][1] - w0[1]))

    th, rms = fit_rotation(lpairs)
    ct, sn = math.cos(th), math.sin(th)

    def to_world(lx, ly):
        return w0[0] + ct * lx - sn * ly, w0[1] + sn * lx + ct * ly

    info.append("Reference markers used: %s" % sorted(refs))
    info.append("Frame fit error: %.1f mm rms" % rms)

    res["frame"] = rg.Plane(rg.Point3d(*w0), rg.Vector3d(1, 0, 0), rg.Vector3d(0, 1, 0))

    rp = inp("robot_pos")
    rx, ry = (rp.X, rp.Y) if rp is not None else (w0[0], w0[1])

    cands = []
    rows = []

    for mid in sorted(st["hist"]):
        hst = st["hist"][mid]
        if mid in ids_ref:
            continue
        nfr = len(hst["t"])

        if nfr < MIN_FRAMES or not hst.get("nm"):
            rows.append("  ID %d: ignored (need %d frames)" % (mid, MIN_FRAMES))
            continue

        nm = med3(hst["nm"])
        tilt = math.degrees(math.acos(min(1.0, abs(dot(nm, n)))))
        lx, ly, lh = local(med3(hst["t"]))

        if tilt > TILT_MAX:
            rows.append("  ID %d: ignored (tilted %.0f deg)" % (mid, tilt))
            continue
        if lh < MIN_H or lh > MAX_H:
            rows.append("  ID %d: ignored (height %.0f outside %.0f..%.0f)" % (mid, lh, MIN_H, MAX_H))
            continue

        ax = med3(hst["ax"])
        yaw = math.atan2(dot(ax, ey), dot(ax, ex)) + th + yaw_extra
        wx, wy = to_world(lx, ly)
        cy, sy = math.cos(yaw), math.sin(yaw)

        wx += cy * toff[0] - sy * toff[1]
        wy += sy * toff[0] + cy * toff[1]

        cands.append({"id": mid, "x": wx, "y": wy, "yaw": yaw, "h": lh,
                      "n": nfr, "tilt": tilt, "dist": math.hypot(wx - rx, wy - ry)})

    # Sort candidates by measured height descending (-b["h"])
    blocks = []
    for b in sorted(cands, key=lambda b: (-b["h"], -b["n"], b["id"])):
        twin = [a for a in blocks if math.hypot(a["x"] - b["x"], a["y"] - b["y"]) < DEDUP_DIST]
        if twin:
            rows.append("  ID %d: duplicate/lower tag dropped" % b["id"])
            continue

        b["layer"] = sum(1 for t in LAYER_THRESHOLDS if b["h"] >= t)
        b["level"] = LEVELS[b["layer"]]

        blocks.append(b)
        rows.append("  ID %d: USED measured=%.0fmm -> snapped Z=%.0fmm (layer %d)" % (
            b["id"], b["h"], b["level"], b["layer"] + 1))

    mb = inp("max_blocks")
    if mb is not None and int(mb) > 0 and len(blocks) > int(mb):
        blocks.sort(key=lambda b: (-b["level"], -b["n"], b["id"]))
        blocks = blocks[:int(mb)]

    # Sort blocks: tallest level first, then closest to robot
    blocks.sort(key=lambda b: (-int(b["level"] // CLUSTER_GAP), b["dist"]))

    if not blocks:
        batch = []
    elif BATCH_SAME_LEVEL:
        hmax = max(b["level"] for b in blocks)
        batch = sorted([b for b in blocks if b["level"] >= hmax - CLUSTER_GAP], key=lambda b: b["dist"])
    else:
        batch = blocks[:1]

    # ---- PARSE END PLANES & FILTER USED ONES
    raw_ends = as_list(inp("end_planes"))
    ends_all = [p for p in [to_plane(e) for e in raw_ends] if p is not None]

    used = st["placed"]
    if ends_all:
        if used >= len(ends_all):
            info.append("NOTICE: All %d end positions used! Toggle 'reset' to restart." % len(ends_all))
            free = []
        else:
            free = ends_all[used:]

        if len(free) < len(batch):
            batch = batch[:len(free)]
        ends = free[:len(batch)]

        if ends:
            info.append("End Plane: Using target #%d of %d total (used so far: %d)" % (used + 1, len(ends_all), used))
    else:
        ends = []
        if batch:
            info.append("No end_planes connected - pick planes only")

    batch_ids = [b["id"] for b in batch]

    for k, b in enumerate(blocks):
        in_batch = b["id"] in batch_ids
        if not in_batch:
            res["later_ids"].append(b["id"])
            if not SHOW_WAITING:
                continue

        cy, sy = math.cos(b["yaw"]), math.sin(b["yaw"])
        xa, ya = rg.Vector3d(cy, sy, 0), rg.Vector3d(-sy, cy, 0)

        top_z = w0[2] + b["level"]
        top = rg.Plane(rg.Point3d(b["x"], b["y"], top_z), xa, ya)

        box = rg.Box(top, rg.Interval(-dims[0] / 2.0, dims[0] / 2.0),
                     rg.Interval(-dims[1] / 2.0, dims[1] / 2.0),
                     rg.Interval(-b["level"], 0.0))
        res["boxes"].append(box.ToBrep())

        txt = "%d | ID %d\nmeasured %.0f -> top Z %.0f" % (k + 1, b["id"], b["h"], b["level"])
        res["labels"].append(rg.TextDot(txt, top.Origin))

        if in_batch:
            pick = rg.Plane(rg.Point3d(b["x"], b["y"], top_z), xa, ya)
            if PICK_FLIP:
                pick = rg.Plane(pick.Origin, pick.XAxis, -pick.YAxis)
            if PICK_ROT_DEG:
                pick.Rotate(math.radians(PICK_ROT_DEG), pick.ZAxis)

            bi = batch_ids.index(b["id"])
            res["picks"].append(pick)
            res["order_ids"].append(b["id"])
            res["heights"].append(b["h"])
            res["levels"].append(b["level"])

            # ---------------- Approach & Depart Planes (300 mm offset) ----------------
            pick_above = offset_above(pick, APPROACH_HEIGHT)

            # 1. 300 mm plane above pick plane
            # 2. Pick plane
            # 3. 300 mm plane above pick plane
            res["sequence"].append(pick_above)
            res["sequence"].append(pick)
            res["sequence"].append(pick_above)

            if bi < len(ends):
                place = ends[bi]
                place_above = offset_above(place, APPROACH_HEIGHT)

                res["place_planes"].append(place)

                # 4. 300 mm plane above place plane
                # 5. Place plane
                # 6. 300 mm plane above place plane
                res["sequence"].append(place_above)
                res["sequence"].append(place)
                res["sequence"].append(place_above)

    res["planes"] = list(res["picks"])
    res["plane"] = res["picks"][0] if res["picks"] else None
    res["n_batch"] = len(batch)
    res["info"] = "\n".join(info)
    return res

# ---------------------------------------------------------------- Sequence Control
seq = st["seq"]
nb = bool(inp("next_block"))
if nb and not seq["prev"] and seq["state"] == "FROZEN":
    if st["result"] is not None:
        st["placed"] += st["result"].get("n_batch", 0)
    seq["state"] = "SCAN"
    seq["t0"] = time.time()
    seq["sig"] = None
    seq["sig_t"] = time.time()
seq["prev"] = nb

if (seq["state"] == "FROZEN" or bool(inp("freeze"))) and st["result"] is not None:
    r = dict(st["result"])
    if not r["info"].startswith("FROZEN"):
        r["info"] = "FROZEN - waiting for next_block\n" + r["info"]
else:
    r = compute()
    sig = tuple(r["order_ids"])
    if sig != seq.get("sig"):
        seq["sig"] = sig
        seq["sig_t"] = time.time()
    stable = (time.time() - seq.get("sig_t", time.time())) >= STABLE_TIME
    waited = time.time() - seq["t0"]
    if r["picks"] and waited >= SCAN_TIME and (stable or waited >= SCAN_TIME + SCAN_MAX):
        seq["state"] = "FROZEN"
        st["result"] = r
    elif seq["state"] == "SCAN":
        r["info"] = "SCANNING...\n" + r["info"]

frozen = (seq["state"] == "FROZEN")

info = r["info"]
plane = r["plane"]
planes = r["planes"]
buried_ids = r["buried_ids"]
picks = r["picks"]
place_planes = r["place_planes"]
sequence = r["sequence"]
n_batch = r["n_batch"]
end_used = r["end_used"]
order_ids = r["order_ids"]
later_ids = r["later_ids"]
heights = r["heights"]
levels = r["levels"]
boxes = r["boxes"]
labels = r["labels"]
frame = r["frame"]
ref_pts = r["ref_pts"]

if bool(inp("run")):
    comp = ghenv.Component

    def _tick(doc):
        comp.ExpireSolution(False)

    comp.OnPingDocument().ScheduleSolution(ival, GH_Document.GH_ScheduleDelegate(_tick))
# ---------- end py3 ----------

# ---- group: Do NOT change / Define the Tool
tcp_pt = Point(<point referenced from the Rhino model>)
xy = XYPlane(Origin=tcp_pt)
prot = RotatePlane(Plane=xy, Angle=degrees(90))
brep = Brep(<brep referenced from the Rhino model>)
create_tool = CreateTool(Name="Gripper", TCP=prot, Weight="0.2", Mesh=brep)  # -> Tool, TCP

# ---- group: Robot setting (only change if necessary) / Speed
speed_mm_s = Slider(90, range=0..100)

# ---- group: Robot setting (only change if necessary) / Flag fields
list = FlagFields({"Shoulder": 1, "Elbow": 2, "Wrist": 4}, selected="Shoulder")

# ---- group: Disassembly process / Python script for disassembly / Block count of the wall/layer
number_slider_2 = Slider(4, range=0..6)

# ---- group: Disassembly process / Python script for disassembly / Scan = on
toggle_3 = BooleanToggle(True)

# ---- group: Disassembly process / Python script for disassembly / Reset
button_2 = Button()

# ---- group: Disassembly process / Python script for disassembly / Path to poses.json
path_2 = FilePath("C:\Users\suzan\OneDrive\Bouwkunde\Bouwkunde master\Master jaar 2\01_ARIT507\02_CAD\08_CV\poses.json")

# ---- group: Disassembly process / Python script for disassembly
py3_2 = Python3Script(
    path=path_2,
    layer_mode=Toggle(False),
    ref_ids=aruco_ids,
    ref_world=aruco_positions,
    neutral_id=neutral_id,
    end_planes=flatten(pflip),
    run=toggle_3,
    reset=button_2,
    max_blocks=number_slider_2)  # -> info, plane, planes, place_planes, flatten(sequence), boxes; inputs ref_ids: list, ref_world: list of Point3d, end_planes: list
# ---------- py3_2: Python ----------
"""
AR Wall Tracker & Robotic Disassembly Planner
=====================================================================================
GhPython: Safe for IronPython 2.7 & Python 3 (Rhino 8)

Inputs:  path, ref_ids, ref_world, neutral_id, end_planes, block_dims,
         run (bool), reset (bool), layer_mode (bool), max_blocks (int, default=6)
Outputs: info, plane, planes, picks, place_planes, sequence, boxes, labels
"""
import json
import math
import time

import Rhino.Geometry as rg
import scriptcontext as sc
from Grasshopper.Kernel import GH_Document

# ---------------------------------------------------------------- CONFIGURATION
APPROACH_HEIGHT = 100.0   # mm clearance height above pick and place planes
PICK_FLIP = True          # Flip pick plane Z axis down into block
PICK_FLIP_AXIS = "Y"      # Axis to rotate about for flipping ("Y" or "X")
PICK_ROT_DEG = 90.0       # Tool yaw rotation relative to block orientation
TIMER_INTERVAL = 200      # ms auto-refresh rate to re-read poses.json live

STABLE_TIME = 1.0         # Seconds block must remain in same position before locking
POS_TOL = 5.0             # mm movement tolerance (jitter threshold) for stability

LEVELS = (50.0, 100.0, 150.0)      # Layer 1, 2, 3 nominal top heights (mm)
LAYER_THRESHOLDS = (60.0, 110.0)  # Height boundaries between layers 1, 2, 3
MIN_H = 10.0
MAX_H = 175.0
TILT_MAX = 85.0           # Max allowed tag tilt from table vertical (deg)
MIN_FRAMES = 3

# ---------------------------------------------------------------- HELPERS
def sub(a, b): 
    return (a[0] - b[0], a[1] - b[1], a[2] - b[2])

def mul(a, s): 
    return (a[0] * s, a[1] * s, a[2] * s)

def dot(a, b): 
    return a[0] * b[0] + a[1] * b[1] + a[2] * b[2]

def cross(a, b): 
    return (a[1] * b[2] - a[2] * b[1], a[2] * b[0] - a[0] * b[2], a[0] * b[1] - a[1] * b[0])

def unit(a):
    if a is None: 
        return None
    n = math.sqrt(dot(a, a))
    return (a[0] / n, a[1] / n, a[2] / n) if n > 1e-9 else None

def median(xs):
    xs = sorted(xs)
    n = len(xs)
    m = n // 2
    return xs[m] if n % 2 else 0.5 * (xs[m - 1] + xs[m])

def med3(vs): 
    if not vs: 
        return (0.0, 0.0, 0.0)
    return tuple(median([v[i] for v in vs]) for i in range(3))

def as_list(v):
    if v is None: 
        return []
    if isinstance(v, (list, tuple)): 
        return list(v)
    try: 
        return [x for x in v]
    except TypeError: 
        return [v]

def parse_int_list(val):
    res = []
    for x in as_list(val):
        try: 
            res.append(int(x))
        except (ValueError, TypeError): 
            pass
    return res

def inp(name): 
    return globals().get(name)

def to_pt(e):
    if e is None: 
        return None
    if isinstance(e, (rg.Point3d, rg.Point3f)): 
        return e
    if isinstance(e, rg.Plane): 
        return e.Origin
    if hasattr(e, "Value"): 
        return to_pt(e.Value)
    if hasattr(e, "X") and hasattr(e, "Y") and hasattr(e, "Z"):
        return rg.Point3d(float(e.X), float(e.Y), float(e.Z))
    try:
        import rhinoscriptsyntax as rs
        pt = rs.coerce3dpoint(e)
        if pt: return pt
    except Exception:
        pass
    return None

def to_plane(e):
    if e is None: 
        return None
    if isinstance(e, rg.Plane): 
        return rg.Plane(e)
    if hasattr(e, "Value"): 
        return to_plane(e.Value)
    if hasattr(e, "Origin") and hasattr(e, "XAxis") and hasattr(e, "YAxis"):
        return rg.Plane(e.Origin, e.XAxis, e.YAxis)
    pt = to_pt(e)
    if pt is not None:
        return rg.Plane(pt, rg.Vector3d(1, 0, 0), rg.Vector3d(0, 1, 0))
    return None

def fit_rotation(pairs):
    sa = sum(lx * wy - ly * wx for lx, ly, wx, wy in pairs)
    sb = sum(lx * wx + ly * wy for lx, ly, wx, wy in pairs)
    th = math.atan2(sa, sb)
    c, s = math.cos(th), math.sin(th)
    err = [math.hypot(c * lx - s * ly - wx, s * lx + c * ly - wy) for lx, ly, wx, wy in pairs]
    return th, math.sqrt(sum(e * e for e in err) / max(1, len(err)))

def offset_above(plane, dist):
    p = rg.Plane(plane)
    p.Translate(rg.Vector3d(0.0, 0.0, float(dist)))
    return p

def create_block_box(input_plane, dimensions, layer_level):
    dx, dy = float(dimensions[0]), float(dimensions[1])
    dz = float(layer_level)
    z_interval = rg.Interval(0.0, dz) if input_plane.ZAxis.Z < 0 else rg.Interval(-dz, 0.0)
    box = rg.Box(input_plane, rg.Interval(-dx / 2.0, dx / 2.0), rg.Interval(-dy / 2.0, dy / 2.0), z_interval)
    return box.ToBrep()

def transform_pick_plane(input_plane):
    p = rg.Plane(input_plane)
    if PICK_ROT_DEG:
        p.Rotate(math.radians(PICK_ROT_DEG), p.ZAxis, p.Origin)
    if PICK_FLIP:
        axis = p.YAxis if str(PICK_FLIP_AXIS).upper() == "Y" else p.XAxis
        p.Rotate(math.pi, axis, p.Origin)
    return p

def is_inside_ground_polygon(px, py, poly_pts):
    n = len(poly_pts)
    inside = False
    p1x, p1y = poly_pts[0]
    for i in range(n + 1):
        p2x, p2y = poly_pts[i % n]
        if py > min(p1y, p2y):
            if py <= max(p1y, p2y):
                if px <= max(p1x, p2x):
                    if p1y != p2y:
                        xinters = (py - p1y) * (p2x - p1x) / (p2y - p1y) + p1x
                    if p1x == p2x or px <= xinters:
                        inside = not inside
        p1x, p1y = p2x, p2y
    return inside

# ---------------------------------------------------------------- STATE SETUP
nav = 10
yaw_extra = 0.0
dims = (100.0, 50.0, 50.0)
try:
    _d = [float(v) for v in as_list(inp("block_dims"))]
    if len(_d) == 3:
        dims = tuple(_d)
except Exception:
    pass

key = "ar_wall_disassembly_" + str(ghenv.Component.InstanceGuid)
st = sc.sticky.get(key)

# PURE RESET: Wipes memory, including used end plane counter
if st is None or bool(inp("reset")):
    st = {
        "last_t": 0.0, 
        "hist": {}, 
        "accumulated_blocks": {}, 
        "scan_complete": False, 
        "last_run": False,
        "placed": 0
    }
    sc.sticky[key] = st

# Detect rising edge of 'run' (False -> True transition)
curr_run = bool(inp("run"))
prev_run = st.get("last_run", False)
st["last_run"] = curr_run

# On 'run' toggle, advance the 'placed' counter by previous batch size before clearing batch
if curr_run and not prev_run and st.get("scan_complete", False):
    st["placed"] += len(st.get("accumulated_blocks", {}))
    st["accumulated_blocks"] = {}
    st["scan_complete"] = False

# ---------------------------------------------------------------- MAIN COMPUTE
def compute():
    info = []
    res = {"info": "", "plane": None, "planes": [], "picks": [], "place_planes": [],
           "sequence": [], "boxes": [], "labels": [], "scan_complete": False}

    if bool(inp("reset")):
        res["info"] = "PURE RESET - Memory cleared. Set 'reset' to False and toggle 'run' to start."
        return res

    ids_ref = parse_int_list(inp("ref_ids"))
    wpts = as_list(inp("ref_world"))
    p_path = inp("path")
    max_b = int(inp("max_blocks")) if inp("max_blocks") is not None else 6
    is_layer_mode = bool(inp("layer_mode"))

    if not p_path:
        res["info"] = "Set 'path' to poses.json"
        return res
    if len(ids_ref) < 3 or len(wpts) != len(ids_ref) or inp("neutral_id") is None or int(inp("neutral_id")) not in ids_ref:
        res["info"] = "Need ref_ids (3+), ref_world (same count/order) and neutral_id in ref_ids"
        return res

    nid = int(inp("neutral_id"))
    world = {}
    for i, p_raw in zip(ids_ref, wpts):
        pt = to_pt(p_raw)
        if pt is not None:
            world[i] = (pt.X, pt.Y, pt.Z)

    data = None
    try:
        with open(p_path, "r") as f:
            content = f.read().strip()
            if content:
                data = json.loads(content)
    except Exception:
        pass

    if data is None and not st["hist"]:
        res["info"] = "Cannot read poses.json"
        return res

    if data is not None and data.get("t", 0.0) != st["last_t"]:
        st["last_t"] = data.get("t", 0.0)
        for sid, m in data.get("markers", {}).items():
            mid = int(sid)
            R = m["R"]
            ax = (R[0][0], R[1][0], R[2][0])
            nm_vec = (R[0][2], R[1][2], R[2][2])
            
            h = st["hist"].setdefault(mid, {})
            h.setdefault("t", [])
            h.setdefault("ax", [])
            h.setdefault("nm", [])
            
            h["t"] = (h["t"] + [tuple(m["t"])])[-nav:]
            h["ax"] = (h["ax"] + [ax])[-nav:]
            h["nm"] = (h["nm"] + [nm_vec])[-nav:]
            h["seen"] = data["t"]

    refs = {}
    for i in ids_ref:
        if i in st["hist"]:
            t_hist = st["hist"][i].get("t", [])
            if t_hist:
                refs[i] = med3(t_hist)

    if nid not in refs or len(refs) < 3:
        res["info"] = "Need neutral and 3+ reference markers in view."
        return res

    ok, plane_fit = rg.Plane.FitPlaneToPoints([rg.Point3d(*p) for p in refs.values()])
    c = (plane_fit.Origin.X, plane_fit.Origin.Y, plane_fit.Origin.Z)
    n_raw = (plane_fit.ZAxis.X, plane_fit.ZAxis.Y, plane_fit.ZAxis.Z)
    if n_raw[2] > 0: 
        n_raw = mul(n_raw, -1.0)
    n = unit(n_raw)

    p0 = refs[nid]
    O = sub(p0, mul(n, dot(sub(p0, c), n)))

    other = sorted(i for i in refs if i != nid)[0]
    v = sub(refs[other], O)
    ex = unit(sub(v, mul(n, dot(v, n))))
    ey = cross(n, ex)

    def local(p):
        r = sub(p, O)
        return dot(r, ex), dot(r, ey), dot(r, n)

    w0 = world[nid]
    lpairs = [(local(p)[0], local(p)[1], world[i][0] - w0[0], world[i][1] - w0[1]) for i, p in refs.items() if i != nid]
    th, rms = fit_rotation(lpairs)
    ct, sn = math.cos(th), math.sin(th)

    ref_poly_2d = [local(refs[i])[:2] for i in sorted(refs.keys())]

    # --- LAYER MODE HEIGHT DETERMINATION ---
    target_layer_level = None
    if is_layer_mode:
        acc_levels = [b["level"] for b in st["accumulated_blocks"].values()]
        if acc_levels:
            target_layer_level = acc_levels[0]
        else:
            cand_levels = []
            for mid, hst in st["hist"].items():
                if mid in ids_ref or mid in st["accumulated_blocks"]:
                    continue
                hist_t = hst.get("t", [])
                if len(hist_t) < MIN_FRAMES:
                    continue
                lx, ly, lh = local(med3(hist_t))
                if not is_inside_ground_polygon(lx, ly, ref_poly_2d) or lh < MIN_H or lh > MAX_H:
                    continue
                l_idx = sum(1 for t in LAYER_THRESHOLDS if lh >= t)
                cand_levels.append(LEVELS[l_idx])
            if cand_levels:
                target_layer_level = max(cand_levels)

    # Dynamic Live Scanner
    unlocked_candidates_on_layer = 0
    if len(st["accumulated_blocks"]) < max_b:
        for mid in sorted(st["hist"]):
            if mid in ids_ref or mid in st["accumulated_blocks"]: 
                continue

            hst = st["hist"][mid]
            hist_t = hst.get("t", [])
            hist_nm = hst.get("nm", [])
            hist_ax = hst.get("ax", [])
            
            if len(hist_t) < MIN_FRAMES or not hist_nm: 
                continue

            lx, ly, lh = local(med3(hist_t))

            # 1. GROUND BOUNDARY CHECK
            if not is_inside_ground_polygon(lx, ly, ref_poly_2d):
                continue

            layer_idx = sum(1 for t in LAYER_THRESHOLDS if lh >= t)
            level = LEVELS[layer_idx]

            # 2. LAYER MODE FILTER: Only process blocks at target height level
            if is_layer_mode and target_layer_level is not None and level != target_layer_level:
                continue

            unlocked_candidates_on_layer += 1

            # 3. POSITION STABILITY CHECK (1.0 second rule)
            curr_pos = (lx, ly, lh)
            last_pos = hst.get("last_pos")
            if last_pos is None or math.hypot(lx - last_pos[0], ly - last_pos[1]) > POS_TOL or abs(lh - last_pos[2]) > POS_TOL:
                hst["pos_start_t"] = st["last_t"]
                hst["last_pos"] = curr_pos

            stable_elapsed = st["last_t"] - hst.get("pos_start_t", st["last_t"])
            if stable_elapsed < STABLE_TIME:
                info.append("[dbg] ID %d stabilizing... (%.1fs / %.1fs)" % (mid, stable_elapsed, STABLE_TIME))
                continue

            # 4. TILT & HEIGHT FILTERS
            nm_vec = unit(med3(hist_nm))
            best_dot = abs(dot(nm_vec, n)) if nm_vec else 0.0
            tilt = math.degrees(math.acos(min(1.0, max(0.0, best_dot))))

            if tilt > TILT_MAX or lh < MIN_H or lh > MAX_H:
                continue

            axv = med3(hist_ax)
            yaw = math.atan2(dot(axv, ey), dot(axv, ex)) + th + yaw_extra
            wx, wy = w0[0] + ct * lx - sn * ly, w0[1] + sn * lx + ct * ly

            dist_neutral = math.hypot(lx, ly)

            # LOCK position into memory permanently once stable
            st["accumulated_blocks"][mid] = {
                "id": mid, "x": wx, "y": wy, "yaw": yaw,
                "h": lh, "level": level, "dist_neutral": dist_neutral
            }

    all_scanned = list(st["accumulated_blocks"].values())

    # Sort: Highest layer first, then closest to Neutral marker
    all_scanned.sort(key=lambda b: (-b["level"], b["dist_neutral"]))
    disassembly_queue = all_scanned[:max_b]

    # Visual Previews
    for idx, b in enumerate(disassembly_queue):
        cy, sy = math.cos(b["yaw"]), math.sin(b["yaw"])
        xa, ya = rg.Vector3d(cy, sy, 0), rg.Vector3d(-sy, cy, 0)
        top_z = w0[2] + b["level"]
        base_top = rg.Plane(rg.Point3d(b["x"], b["y"], top_z), xa, ya)

        res["boxes"].append(create_block_box(base_top, dims, b["level"]))
        lbl = "#%d [ID %d]\nLayer Z: %.0fmm" % (idx + 1, b["id"], b["level"])
        res["labels"].append(rg.TextDot(lbl, base_top.Origin))

    # Parse End Planes and Offset target index using st["placed"]
    ends_all = [to_plane(p) for p in as_list(inp("end_planes")) if to_plane(p) is not None]
    placed_so_far = st.get("placed", 0)

    for idx, b in enumerate(disassembly_queue):
        cy, sy = math.cos(b["yaw"]), math.sin(b["yaw"])
        xa, ya = rg.Vector3d(cy, sy, 0), rg.Vector3d(-sy, cy, 0)
        top_z = w0[2] + b["level"]
        base_top = rg.Plane(rg.Point3d(b["x"], b["y"], top_z), xa, ya)

        pick = transform_pick_plane(base_top)
        res["picks"].append(pick)

        pick_above = offset_above(pick, APPROACH_HEIGHT)
        res["sequence"].extend([pick_above, pick, pick_above])

        # Assign end plane offset by total blocks previously disassembled
        end_idx = placed_so_far + idx
        if end_idx < len(ends_all):
            place = rg.Plane(ends_all[end_idx])
            place_above = offset_above(place, APPROACH_HEIGHT)
            res["place_planes"].append(place)
            res["sequence"].extend([place_above, place, place_above])

    res["planes"] = list(res["picks"])
    res["plane"] = res["picks"][0] if res["picks"] else None
    
    # Mode & Scan Completion Status
    mode_str = ("LAYER MODE (Target Z: %.0fmm)" % target_layer_level) if (is_layer_mode and target_layer_level) else "MULTI-LAYER MODE"
    
    if len(st["accumulated_blocks"]) >= max_b or (is_layer_mode and len(st["accumulated_blocks"]) > 0 and unlocked_candidates_on_layer == 0):
        res["scan_complete"] = True
        st["scan_complete"] = True
        info.append("[%s] SCAN COMPLETE - %d block(s) ready. Total placed so far: %d. Cycle 'run' for next layer." % 
                    (mode_str, len(disassembly_queue), placed_so_far + len(disassembly_queue)))
    elif not bool(inp("run")):
        info.append("PAUSED - Set 'run' to True to start scanning. Total placed so far: %d" % placed_so_far)
    else:
        info.append("[%s] LIVE SCANNING - Saved wall blocks: %d / %d (Total placed so far: %d)" % 
                    (mode_str, len(disassembly_queue), max_b, placed_so_far))
        
    res["info"] = "\n".join(info)
    return res

r = compute()

# Auto-Stop & Reset Controlled Timer
if bool(inp("run")) and not bool(inp("reset")) and not r.get("scan_complete", False):
    comp = ghenv.Component
    def _tick(doc):
        comp.ExpireSolution(False)
    comp.OnPingDocument().ScheduleSolution(TIMER_INTERVAL, GH_Document.GH_ScheduleDelegate(_tick))

info = r["info"]
plane = r["plane"]
planes = r["planes"]
picks = r["picks"]
place_planes = r["place_planes"]
sequence = r["sequence"]
boxes = r["boxes"]
labels = r["labels"]
# ---------- end py3_2 ----------
panel_4 = Panel(py3_2.info)

# ---- group: Do NOT change
open_gripper = SetDO(DO="4", Value=Toggle(False))
wait = Wait(Time=1)
close_gripper = SetDO(DO="4", Value=Toggle(True))
wait_2 = Wait(Time=1)
wait_3 = Wait(Time=1)
wait_4 = Wait(Time=1)
merge = Merge(Data1=wait_4, Data2=close_gripper, Data3=wait)
merge_2 = Merge(Data1=wait_2, Data2=open_gripper, Data3=wait_3)
group_cmd = GroupCommand(Commands=merge)
group_cmd_2 = GroupCommand(Commands=merge_2)
ins = InsertItems(List=group_cmd_2, Indices=0, Wrap=True)
merge_3 = Merge(Data1=group_cmd, Data2=group_cmd_2)
ins_2 = InsertItems(List=merge_3, Indices=[1, 1, 2, 2], Wrap=True)
lng = ListLength(List=py3_2.sequence)
repeat = RepeatData(Data=ins_2, Length=lng)
merge_4 = Merge(Data1=ins, Data2=repeat)  # -> flatten(Result)

# ---- group: Robot setting (only change if necessary)
xz_plane = XZPlane(Origin=home_position)
merge_5 = Merge(Data1=xz_plane, Data2=py3_2.sequence, Data3=xz_plane)

# ---- group: Robot setting (only change if necessary) / Define the targets and their variables
list_2 = ValueList({"Joint", "Linear", "Process"}, selected="Joint")
createtarget = CreateTarget(
    Plane=merge_5,
    Configuration=list,
    Motion=list_2,
    Tool=create_tool.Tool,
    Speed=speed_mm_s,
    Command=merge_4,
    IsCartesian=True)

# ---- group: Robot setting (only change if necessary) / Robots library
list_3 = RobotsLibrary({"TUDelft-LAMA-UR5 (missing)": "TUDelft-LAMA-UR5"}, selected="TUDelft-LAMA-UR5 (missing)", Type=0)

# ---- group: Robot setting (only change if necessary) / Program name
panel_5 = Panel("Disassembly")

# ---- group: Robot setting (only change if necessary) / Create the robot program
loadrobot = LoadRobotSystem(Name=list_3, Base=PlaneXY(0, 0, 0))
create_program = CreateProgram(Name=panel_5, RobotSystem=loadrobot, Targets=createtarget, StepSize=1)  # -> Program, Code, Duration, Warnings, Errors

# ----
panel_6 = Panel(create_program.Errors)

# ---- group: Disassembly process / Connect and control the robot / Robot IP
panel_7 = Panel("192.168.1.2")

# ---- group: Disassembly process / Connect and control the robot / Run program
button_3 = Button()

# ---- group: Disassembly process / Connect and control the robot
remote_connection = RemoteConnection(Program=create_program.Program, IP=panel_7, Upload=button_3, Play=Button(), Pause=Button())

# ---- group: Robot setting (only change if necessary) / Simulate the robot program
program_simulation = ProgramSimulation(Program=create_program.Program, Time=0, Normalized=True)  # -> SystemMeshes, JointRotations, Plane, Index, Time, Program, Errors
simple_trail = SimpleTrail(Program=program_simulation.Program, Length=500, MechanicalGroup=0)
